# Grasshopper definition HALO.gh (Grasshopper 1.0.8)

tensegrity_module_length = Slider(5, range=1..10)
# Grasshopper Companion File for halo.ifylab.dev
# by Hossein Zargar
tensegrity_module_radius = Slider(4, range=0..10)
tensegrity_segments = Slider(6, range=3..10)
module_count = Slider(5, range=1..20)
strut_radius = Slider(0.188, range=0.01..1)
mid_scale = Slider(0.98, range=0.5..2)
polygon = Polygon(Plane=PlaneXY(0, 0, 0), Radius=tensegrity_module_radius, Segments=tensegrity_segments, FilletRadius=0)  # -> Polygon, Length; disabled
xz = XZPlane(Origin=Point(0, 0, 0))  # disabled
w1_tensegrity_module = Python3Script(
    segments=tensegrity_segments,
    module_radius=tensegrity_module_radius,
    module_length=tensegrity_module_length,
    module_count=module_count,
    mid_scale=mid_scale,
    strut_radius=strut_radius)  # -> out, assembly, pipes, cables, members, families, metrics, node_count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; inputs segments: Int32, module_radius: Double, module_length: Double, module_count: Int32, mid_scale: Double, strut_radius: Double
# ---------- w1_tensegrity_module: Python ----------
#! python 3
# wireify W1 tensegrity-module @a9873c08
"""HALO - tensegrity hollow-rope module, form generation.

Port of the wired definition (Polygon -> Rotate -> Linear Array, an offset/scaled/
rotated set of rings, Weave, Control Polygon, Relative Item(s), Line, Mirror,
duplicate removal, Merge, Pipe and Explode), driven by the six Form Generation
parameters of the HALO flowchart.

Member families follow the paper's build sequence: secondary (peripheral) cables,
diagonal struts, secondary struts, X-cables.

inner_opening and min_clearance are measured from the generated geometry - they are
not force-density results; this definition has no form-finding stage.

The geometric core works on plain (x, y, z) tuples and integer index pairs.
RhinoCommon types are built only in the final section.
"""

import math

import System
import Rhino
import Rhino.Geometry as rg

MID_OFFSET_DIVISOR = 2.0                           # mid rings sit at module_length / 2
MID_ROTATION_DEG = 180.0                           # mid rings spun about +X at the origin
TIE_OFFSETS = ((0, 2), (-1, 2), (0, 3), (-1, 3))   # X-cable offset rules

# --- inputs -----------------------------------------------------------------

n_seg = 5 if segments is None else int(segments)
radius = 4.0 if module_radius is None else float(module_radius)
span = 6.0 if module_length is None else float(module_length)
ring_count = 5 if module_count is None else int(module_count)
scale_mid = 1.1 if mid_scale is None else float(mid_scale)
strut_r = 0.1 if strut_radius is None else float(strut_radius)

if n_seg < 3:
    raise ValueError("segments must be at least 3 (got %d)" % n_seg)
if radius <= 0.0:
    raise ValueError("module_radius must be positive (got %g)" % radius)
if span <= 0.0:
    raise ValueError("module_length must be positive (got %g)" % span)
if ring_count < 1:
    raise ValueError("module_count must be at least 1 (got %d)" % ring_count)
if scale_mid <= 0.0:
    raise ValueError("mid_scale must be positive (got %g)" % scale_mid)
if strut_r <= 0.0:
    raise ValueError("strut_radius must be positive (got %g)" % strut_r)

# --- document context: the only values the core takes from Rhino ------------

doc = Rhino.RhinoDoc.ActiveDoc
tol = doc.ModelAbsoluteTolerance if doc else 0.001
ang_tol = doc.ModelAngleToleranceRadians if doc else math.radians(1.0)
try:
    unit_name = doc.GetUnitSystemName(False, True, True, False)
except Exception:
    unit_name = "units"

# --- pure geometric core ----------------------------------------------------


class NodeRegistry(object):
    """Collapses coincident points (within tol) onto shared vertex indices."""

    def __init__(self, tolerance):
        self.tol = tolerance
        self.points = []
        self._buckets = {}

    def _cell(self, p):
        t = self.tol
        return (int(math.floor(p[0] / t)), int(math.floor(p[1] / t)), int(math.floor(p[2] / t)))

    def index(self, p):
        cx, cy, cz = self._cell(p)
        t2 = self.tol * self.tol
        for dx in (-1, 0, 1):
            for dy in (-1, 0, 1):
                for dz in (-1, 0, 1):
                    for i in self._buckets.get((cx + dx, cy + dy, cz + dz), ()):
                        q = self.points[i]
                        d2 = (q[0] - p[0]) ** 2 + (q[1] - p[1]) ** 2 + (q[2] - p[2]) ** 2
                        if d2 <= t2:
                            return i
        i = len(self.points)
        self.points.append(p)
        self._buckets.setdefault((cx, cy, cz), []).append(i)
        return i


def ring_points(x, r, count, rotation_deg):
    """One ring in the plane x = const, first vertex on +Z, then spun about +X."""
    a = math.radians(rotation_deg)
    ca, sa = math.cos(a), math.sin(a)
    step = 2.0 * math.pi / count
    pts = []
    for j in range(count):
        y = r * math.sin(j * step)
        z = r * math.cos(j * step)
        pts.append((x, y * ca - z * sa, y * sa + z * ca))
    return pts


def mirror_y(p):
    return (p[0], -p[1], p[2])


main_rings = [ring_points(i * span, radius, n_seg, 0.0)
              for i in range(ring_count)]
mid_rings = [ring_points(span / MID_OFFSET_DIVISOR + i * span,
                         radius * scale_mid, n_seg, MID_ROTATION_DEG)
             for i in range(ring_count - 1)]

nodes = NodeRegistry(tol)
main_ix = [[nodes.index(p) for p in r] for r in main_rings]
mid_ix = [[nodes.index(p) for p in r] for r in mid_rings]
n_modules = len(mid_rings)

# Secondary (peripheral) cables: each main ring's own perimeter, per ring.
ring_edges = []
for r in main_ix:
    edges = []
    for j in range(n_seg):
        edges.append((r[j], r[(j + 1) % n_seg]))
    ring_edges.append(edges)

# Diagonal struts: main ring i vertex j -> main ring i+1 vertex j+1, per module.
diagonals = []
for i in range(n_modules):
    run = []
    for j in range(n_seg):
        run.append((main_ix[i][j], main_ix[i + 1][(j + 1) % n_seg]))
    diagonals.append(run)

# Secondary struts: the same rule walked over the woven main/offset ring sequence,
# which is what gives the continuous compression route of a hollow rope.
woven = []
for i in range(ring_count):
    woven.append(main_ix[i])
    if i < n_modules:
        woven.append(mid_ix[i])

secondaries = [[] for _ in range(n_modules)]
for k in range(len(woven) - 1):
    for j in range(n_seg):
        secondaries[k // 2].append((woven[k][j], woven[k + 1][(j + 1) % n_seg]))

# X-cables: main ring p vertex i -> offset ring p+dp vertex i+di, then mirrored in
# Y. Vertex indices run over the closed ring (0..n_seg) and never wrap, which is
# what caps the count per offset rule.
xcables = [[] for _ in range(n_modules)]
seen = set()
duplicate_ties = 0
for p in range(ring_count):
    for i in range(n_seg + 1):
        for dp, di in TIE_OFFSETS:
            q = p + dp
            if not (0 <= q < n_modules) or i + di > n_seg:
                continue
            a = nodes.index(mirror_y(main_rings[p][i % n_seg]))
            b = nodes.index(mirror_y(mid_rings[q][(i + di) % n_seg]))
            key = (min(a, b), max(a, b))
            if key in seen:
                duplicate_ties += 1
                continue
            seen.add(key)
            xcables[q].append((a, b))

flat_rings = [e for run in ring_edges for e in run]
flat_diagonals = [e for run in diagonals for e in run]
flat_secondaries = [e for run in secondaries for e in run]
flat_xcables = [e for run in xcables for e in run]

FAMILY_SPECS = (
    ("ring", "secondary cables", "tension", flat_rings),
    ("diag", "diagonal struts", "compression", flat_diagonals),
    ("sec", "secondary struts", "compression", flat_secondaries),
    ("xcable", "X-cables", "tension", flat_xcables),
)

strut_members = flat_secondaries + flat_diagonals    # what gets piped
cable_members = flat_rings + flat_xcables            # what stays a line
all_members = flat_diagonals + flat_secondaries + flat_rings + flat_xcables


def member_length(pair):
    a, b = nodes.points[pair[0]], nodes.points[pair[1]]
    return math.sqrt((a[0] - b[0]) ** 2 + (a[1] - b[1]) ** 2 + (a[2] - b[2]) ** 2)


def axis_distance(pair):
    """Closest approach of a member to the module axis (the world X axis)."""
    a, b = nodes.points[pair[0]], nodes.points[pair[1]]
    dy, dz = b[1] - a[1], b[2] - a[2]
    den = dy * dy + dz * dz
    t = 0.0 if den <= 0.0 else max(0.0, min(1.0, -(a[1] * dy + a[2] * dz) / den))
    y, z = a[1] + t * dy, a[2] + t * dz
    return math.sqrt(y * y + z * z)


def segment_distance(p1, q1, p2, q2):
    """Closest distance between two finite segments."""
    d1 = (q1[0] - p1[0], q1[1] - p1[1], q1[2] - p1[2])
    d2 = (q2[0] - p2[0], q2[1] - p2[1], q2[2] - p2[2])
    r = (p1[0] - p2[0], p1[1] - p2[1], p1[2] - p2[2])
    a = d1[0] * d1[0] + d1[1] * d1[1] + d1[2] * d1[2]
    e = d2[0] * d2[0] + d2[1] * d2[1] + d2[2] * d2[2]
    f = d2[0] * r[0] + d2[1] * r[1] + d2[2] * r[2]
    eps = 1e-12
    if a <= eps and e <= eps:
        s = t = 0.0
    elif a <= eps:
        s = 0.0
        t = max(0.0, min(1.0, f / e))
    else:
        c = d1[0] * r[0] + d1[1] * r[1] + d1[2] * r[2]
        if e <= eps:
            t = 0.0
            s = max(0.0, min(1.0, -c / a))
        else:
            b = d1[0] * d2[0] + d1[1] * d2[1] + d1[2] * d2[2]
            den = a * e - b * b
            s = max(0.0, min(1.0, (b * f - c * e) / den)) if den > eps else 0.0
            t = (b * s + f) / e
            if t < 0.0:
                t = 0.0
                s = max(0.0, min(1.0, -c / a))
            elif t > 1.0:
                t = 1.0
                s = max(0.0, min(1.0, (b - c) / a))
    cx = p1[0] + d1[0] * s - p2[0] - d2[0] * t
    cy = p1[1] + d1[1] * s - p2[1] - d2[1] * t
    cz = p1[2] + d1[2] * s - p2[2] - d2[2] * t
    return math.sqrt(cx * cx + cy * cy + cz * cz)


def strut_clearance(pairs, limit):
    """Tightest approach between struts that share no node, by an X sweep."""
    items = []
    for (ia, ib) in pairs:
        pa, pb = nodes.points[ia], nodes.points[ib]
        items.append((min(pa[0], pb[0]), max(pa[0], pb[0]), ia, ib, pa, pb))
    items.sort(key=lambda it: it[0])
    best = None
    hits = 0
    for i in range(len(items)):
        x1i = items[i][1]
        ia, ib, pai, pbi = items[i][2], items[i][3], items[i][4], items[i][5]
        for j in range(i + 1, len(items)):
            if items[j][0] > x1i:
                break
            ja, jb = items[j][2], items[j][3]
            if ia == ja or ia == jb or ib == ja or ib == jb:
                continue
            d = segment_distance(pai, pbi, items[j][4], items[j][5])
            if best is None or d < best:
                best = d
            if d < limit:
                hits += 1
    return best, hits


# The clear void about the axis: a strut takes its pipe radius off the opening,
# a cable is a line and takes nothing.
opening = None
for pair in strut_members:
    d = axis_distance(pair) - strut_r
    if opening is None or d < opening:
        opening = d
for pair in cable_members:
    d = axis_distance(pair)
    if opening is None or d < opening:
        opening = d
inner_opening = round(max(0.0, opening if opening is not None else 0.0), 6)

clearance, collisions = strut_clearance(strut_members, 2.0 * strut_r)
min_clearance = -1.0 if clearance is None else round(clearance, 6)

used = [nodes.points[i] for i in sorted(set([i for pair in all_members for i in pair]))]
extents = [(min(p[k] for p in used), max(p[k] for p in used)) for k in range(3)]
overall_length = round(extents[0][1] - extents[0][0], 6)

families = []
for key, label, role, pairs in FAMILY_SPECS:
    if not pairs:
        families.append("%s|%s|%s|0|0|0|0" % (key, label, role))
        continue
    lengths = [member_length(p) for p in pairs]
    families.append("%s|%s|%s|%d|%.4f|%.4f|%.4f"
                    % (key, label, role, len(pairs),
                       min(lengths), max(lengths), sum(lengths)))

# Member rows for the page's section and elevation, ordered module by module so a
# truncated read still shows whole modules rather than one family.
row_order = []
for m in range(n_modules):
    row_order.append(("ring", ring_edges[m]))
    row_order.append(("diag", diagonals[m]))
    row_order.append(("sec", secondaries[m]))
    row_order.append(("xcable", xcables[m]))
row_order.append(("ring", ring_edges[ring_count - 1]))

members = []
for family, run in row_order:
    for pair in run:
        a, b = nodes.points[pair[0]], nodes.points[pair[1]]
        members.append("%s,%.4f,%.4f,%.4f,%.4f,%.4f,%.4f"
                       % (family, a[0], a[1], a[2], b[0], b[1], b[2]))

# --- Rhino boundary ---------------------------------------------------------

cap_none = System.Enum.ToObject(rg.PipeCapMode, 0)


def to_curve(pair):
    a, b = nodes.points[pair[0]], nodes.points[pair[1]]
    return rg.LineCurve(rg.Point3d(a[0], a[1], a[2]), rg.Point3d(b[0], b[1], b[2]))


pipes = []
for pair in strut_members:
    built = rg.Brep.CreatePipe(to_curve(pair), strut_r, False, cap_none,
                               False, tol, ang_tol)
    if not built:
        raise RuntimeError("pipe failed on member %s" % (pair,))
    pipes.extend(built)

cables = [to_curve(c) for c in cable_members]
assembly = list(pipes) + list(cables)

node_count = len(nodes.points)
member_count = len(all_members)
total_length = round(sum(member_length(m) for m in all_members), 6)


def group_line(label, pairs):
    if not pairs:
        return "  %s: none" % label
    lengths = [member_length(p) for p in pairs]
    lo, hi, total = min(lengths), max(lengths), sum(lengths)
    if hi - lo <= tol:
        return "  %s: %d members, %.4f each, total %.3f" % (label, len(pairs), lo, total)
    return "  %s: %d members, %.4f to %.4f, total %.3f" % (label, len(pairs), lo, hi, total)


metrics = [
    "units: %s (document tolerance %g)" % (unit_name, tol),
    "form generation: %d-gon, %d rings, %d modules" % (n_seg, ring_count, n_modules),
    "module length %.4f, ring radius %.4f, mid scale %.3f (radius %.4f), strut radius %.4f"
    % (span, radius, scale_mid, radius * scale_mid, strut_r),
    "nodes: %d" % node_count,
    "members: %d" % member_count,
]
for key, label, role, pairs in FAMILY_SPECS:
    metrics.append(group_line(label, pairs))
metrics += [
    "duplicate X-cables removed: %d" % duplicate_ties,
    "total member length: %.3f" % total_length,
    "piped members: %d (struts), pipe radius %.4f, no caps" % (len(pipes), strut_r),
    "cable curves: %d (%d ring + %d X-cable)" % (len(cables), len(flat_rings), len(flat_xcables)),
    "inner opening (clear radius about the module axis): %.4f" % inner_opening,
    ("strut clearance: not applicable - fewer than two independent struts"
     if min_clearance < 0.0 else
     "strut clearance: %.4f closest approach, %d pair(s) under %.4f (2 x strut radius)"
     % (min_clearance, collisions, 2.0 * strut_r)),
    "overall length along the module axis: %.3f" % overall_length,
    "extents y: %.3f to %.3f" % extents[1],
    "extents z: %.3f to %.3f" % extents[2],
]
# ---------- end w1_tensegrity_module ----------
panel = Panel("5")  # disabled
rotate = Rotate(Geometry=polygon.Polygon, Angle=1.570796327, Plane=xz)  # -> Geometry, Transform; disabled
X = UnitX(Factor=tensegrity_module_length)  # disabled
arrlinear = LinearArray(Geometry=rotate.Geometry, Direction=X, Count=panel)  # -> Geometry, Transform; disabled
division = Division(A=X, B=2)  # disabled
panel_2 = Panel("-1")  # disabled
move = Move(Geometry=arrlinear.Geometry, Motion=division)  # -> Geometry, Transform; disabled
panel_3 = Panel("{1;1}")  # disabled
cpoly = ControlPolygon(Curve=arrlinear.Geometry)  # -> Polygon, simplify(graft(Points)); disabled
cull_i = CullIndex(List=move.Geometry, Indices=panel_2, Wrap=True)  # disabled
number_slider = Slider(1.1, range=0..10)  # disabled
relitem = RelativeItem(Tree=cpoly.Points, Offset=panel_3, WrapPaths=False, WrapItems=False)  # -> ItemA, ItemB; disabled
pcen = PolygonCenter(Polyline=cull_i)  # -> CenterV, CenterE, CenterA; disabled
panel_4 = Panel("180")  # disabled
yz = YZPlane(Origin=Point(0, 0, 0))  # disabled
scale = Scale(Geometry=cull_i, Center=pcen.CenterV, Factor=number_slider)  # -> Geometry, Transform; disabled
ln = Line(StartPoint=relitem.ItemA, EndPoint=relitem.ItemB)  # disabled
rotate_2 = Rotate(Geometry=scale.Geometry, Angle=degrees(panel_4), Plane=yz)  # -> Geometry, Transform; disabled
panel_5 = Panel("""{0;2}
{-1;2}
{0;3}
{-1;3}""")  # disabled
cpoly_2 = ControlPolygon(Curve=arrlinear.Geometry)  # -> Polygon, simplify(graft(Points)); disabled
cpoly_3 = ControlPolygon(Curve=rotate_2.Geometry)  # -> Polygon, simplify(graft(Points)); disabled
weave = Weave(Pattern=[0, 1], Stream0=arrlinear.Geometry, Stream1=rotate_2.Geometry, NullGaps=False)  # disabled
panel_6 = Panel("{1;1}")  # disabled
cpoly_4 = ControlPolygon(Curve=weave)  # -> Polygon, simplify(graft(Points)); disabled
relitem2 = RelativeItems(TreeA=cpoly_2.Points, TreeB=cpoly_3.Points, Offset=panel_5, WrapPaths=False, WrapItems=False)  # -> ItemA, ItemB; disabled
relitem_2 = RelativeItem(Tree=cpoly_4.Points, Offset=panel_6, WrapPaths=False, WrapItems=False)  # -> ItemA, ItemB; disabled
xz_2 = XZPlane(Origin=Point(0, 0, 0))  # disabled
ln_2 = Line(StartPoint=relitem2.ItemA, EndPoint=relitem2.ItemB)  # disabled
ln_3 = Line(StartPoint=relitem_2.ItemA, EndPoint=relitem_2.ItemB)  # disabled
mirror = Mirror(Geometry=ln_2, Plane=xz_2)  # -> Geometry, Transform; disabled
dupln = RemoveDuplicateLines(Lines=mirror.Geometry, Tolerance=0.01)  # disabled
merge = Merge(Data1=flatten(arrlinear.Geometry), Data2=flatten(dupln))  # disabled
panel_7 = Panel("0.1")  # disabled
merge_2 = Merge(Data1=flatten(ln_3), Data2=flatten(ln))  # disabled
explode = Explode(Curve=merge, Recursive=True)  # -> Segments, Vertices; disabled
pipe = Pipe(Curve=merge_2, Radius=panel_7, Caps=0, FitRail=False)  # disabled
swatch = ColourSwatch(SwatchColor=RGB(255, 56, 56))  # disabled
swatch_2 = ColourSwatch(SwatchColor=RGB(0, 0, 0))  # disabled
preview = CustomPreview(Geometry=pipe, Shader=swatch)  # disabled
preview_2 = CustomPreview(Geometry=explode.Segments, Shader=swatch_2)  # disabled
